# Grasshopper definition Skill 1-p2-Popularity of Han Culture across London-GH.gh (Grasshopper 1.0.7)
# plug-ins: LunchBox, ShapeDiverForGrasshopper, Weaverbird, Human

sddp = ShapeDiverDocumentPayload({AbsoluteTolerance=0, AngleTolerance=0, DistanceDisplayPrecision=0, GltfVersion="Gltf2", InputGroups="{}", OutputGroups="{}", RelativeTolerance=0, UnitSystem=0, VersionCreated="1.13.1.0", VersionSaved="1.13.1.0"})

# ---- group: Select one File
path = FilePath("D:\A\Skills Module 1 — Cartographies of Affect\1.xls")

# ----
excelread = ExcelReader(ReadExcelData=Toggle(True), WorkbookPath=path, WorksheetName="Sheet1")  # -> Exceptions, ExcelData

# ---- group: 范围边长
# Top Arc Surface Bisector
number_slider = Slider(12, range=0..100)

# ---- group: 网格移动距离
# White Grid
number_slider_2 = Slider(0.4, range=0..10)

# ---- group: 十字符号大小
number_slider_3 = Slider(0.12, range=0..1)

# ---- group: 整体高度
number_slider_4 = Slider(10, range=0..10)

# ---- group: uv均分数
number_slider_5 = Slider(8, range=0..100)

# ---- group: 网格细分数
number_slider_6 = Slider(50, range=0..100)

# ---- group: uv方向数量
number_slider_7 = Slider(32, range=0..100)

# ---- group: 网格方向控制点数量
number_slider_8 = Slider(100, range=0..100)

# ---- group: 长度区间值
number_slider_9 = Slider(1.11, range=0..10)
number_slider_10 = Slider(5, range=0..10)

# ---- group: 向下移动距离
number_slider_11 = Slider(0.78, range=0..10)

# ---- group: 网格影响范围
number_slider_12 = Slider(1, range=0..10)

# ---- group: 整体顺滑级别
number_slider_13 = Slider(22, range=0..100)

# ---- group: 均分线高度
number_slider_14 = Slider(0.028, range=0..1)

# ----
shift = ShiftList(List=excelread.ExcelData, Shift=1, Wrap=False)
bnd = Bounds(Numbers=shift)
dom = ConstructDomain(DomainStart=0, DomainEnd=number_slider)
remap = RemapNumbers(Value=shift, Source=bnd, Target=dom)  # -> Mapped, Clipped
bang = ExplodeTree(Data=remap.Mapped)  # -> Branch0, Branch1
rectangle = Rectangle(Plane=PlaneXY(0, 0, 0), XSize=number_slider, YSize=number_slider, Radius=0)  # -> Rectangle, Length
sdivide = DivideSurface(Surface=rectangle.Rectangle, UCount=number_slider_6, VCount=number_slider_6)  # -> flatten(Points), Normals, Parameters
pt = ConstructPoint(XCoordinate=bang.Branch0, YCoordinate=bang.Branch1, ZCoordinate=0)
pt_2 = Point(sdivide.Points)
cullpt = CullDuplicates(Points=pt, Tolerance=0.1, CullMode=3)  # -> Points, Indices, Valence
dist = Distance(PointA=graft(cullpt.Points), PointB=pt_2)
flip = FlipMatrix(Data=dist)
min = Minimum(A=flip, B=number_slider_12)
ma = MassAddition(Input=min)  # -> flatten(Result), PartialResults
bnd_2 = Bounds(Numbers=ma.Result)
remap_2 = RemapNumbers(Value=ma.Result, Source=bnd_2, Target=Domain(0, 1))  # -> Mapped, Clipped
dom_2 = ConstructDomain(DomainStart=Slider(4.5, range=0..10), DomainEnd=Slider(0, range=0..100))
number_slider_15 = Slider(100, range=0..100)

Z = UnitZ(Factor=expr("-x", number_slider_2))
move = Move(Geometry=rectangle.Rectangle, Motion=Z)  # -> Geometry, Transform
sdivide_2 = DivideSurface(Surface=move.Geometry, UCount=number_slider_5, VCount=number_slider_5)  # -> Points, Normals, Parameters
dom_3 = ConstructDomain(DomainStart=expr("-x", number_slider_3), DomainEnd=number_slider_3)
flip_2 = FlipMatrix(Data=sdivide_2.Points)
rectangle_2 = Rectangle(Plane=sdivide_2.Points, XSize=dom_3, YSize=dom_3, Radius=0)  # -> Rectangle, Length
pline = PolyLine(Vertices=sdivide_2.Points, Closed=False)  # -> flatten(Polyline)
pline_2 = PolyLine(Vertices=flip_2, Closed=False)  # -> flatten(Polyline)
explode = Explode(Curve=rectangle_2.Rectangle, Recursive=True)  # -> Segments, Vertices
shift_2 = ShiftList(List=pline, Shift=1, Wrap=False)
shift_3 = ShiftList(List=pline_2, Shift=1, Wrap=False)
addition = Addition(A=number_slider_4, B=number_slider_2)
midpt = CurveMiddle(Curve=explode.Segments)
shift_4 = ShiftList(List=shift_2, Shift=-1, Wrap=False)
shift_5 = ShiftList(List=shift_3, Shift=-1, Wrap=False)
item = ListItem(List=midpt, Index=0, Wrap=True)  # -> Item, Item1, Item2, Item3
Z_2 = UnitZ(Factor=expr("-x", addition))
ln = Line(StartPoint=item.Item1, EndPoint=item.Item3)
ln_2 = Line(StartPoint=item.Item, EndPoint=item.Item2)
dash = DashPattern(Curve=[shift_4, shift_5], Pattern=Slider(0.12, range=0..1))  # -> Dashes, Gaps
move_2 = Move(Geometry=[ln_2, ln], Motion=Z_2)  # -> Geometry, Transform
move_3 = Move(Geometry=dash.Dashes, Motion=Z_2)  # -> Geometry, Transform
move_4 = Move(Geometry=move.Geometry, Motion=Z_2)  # -> Geometry, Transform
previewlw = CustomPreviewLineweights(Geometry=flatten([move.Geometry, move_4.Geometry]), Shader=ColourSwatch(SwatchColor=RGB(255, 255, 255)), Absolute=False)
previewlw_2 = CustomPreviewLineweights(Geometry=flatten([dash.Dashes, move_3.Geometry]), Shader=ColourSwatch(SwatchColor=RGB(176, 176, 176)), Absolute=False)
previewlw_3 = CustomPreviewLineweights(
    Geometry=flatten([ln_2, ln, move_2.Geometry]),
    Shader=ColourSwatch(SwatchColor=RGB(255, 255, 255)),
    Thickness=Slider(3.48, range=0..10),
    Absolute=False)

boundary = BoundarySurfaces(Edges=move.Geometry)
mesh_uv = MeshSurface(Surface=boundary, UCount=number_slider_8, VCount=number_slider_8, Overhang=True, Equalize=False)
demesh = DeconstructMesh(Mesh=mesh_uv)  # -> Vertices, Faces, Colours, Normals
pull = PullPoint(Point=demesh.Vertices, Geometry=cullpt.Points, ClosestOnly=True)  # -> ClosestPoint, Distance
# Black and White Ground
bnd_3 = Bounds(Numbers=flatten(pull.Distance))
dedomain = DeconstructDomain(Domain=bnd_3)  # -> Start, End
gradient = Gradient(
    LowerLimit=dedomain.Start,
    UpperLimit=dedomain.End,
    Parameter=flatten(pull.Distance),
    stops=[0: RGB(255, 255, 255), 0.0123: RGB(0, 0, 0)])
Z_3 = UnitZ(Factor=expr("-x", addition))
conmesh = ConstructMesh(Vertices=demesh.Vertices, Faces=demesh.Faces, Colours=gradient)
move_5 = Move(Geometry=conmesh, Motion=Z_3)  # -> Geometry, Transform

# ---- group: 曲面形态函数
graph = GraphMapper(
    remap_2.Mapped,
    x0=0,
    x1=1,
    y0=0,
    y1=1,
    container_name="Bezier",
    cpx=[0, 0.1683526486, 1, 1],
    cpy=[0, 0.3642604947, 0.4532642961, 1])

# ----
bnd_4 = Bounds(Numbers=graph)
remap_3 = RemapNumbers(Value=graph, Source=bnd_4, Target=dom_2)  # -> Mapped, Clipped
Z_4 = UnitZ(Factor=remap_3.Mapped)
move_6 = Move(Geometry=pt_2, Motion=Z_4)  # -> Geometry, Transform
srfgrid = SurfaceFromPoints(Points=move_6.Geometry, UCount=expr("x+1", number_slider_6), Interpolate=False)
mesh_uv_2 = MeshSurface(Surface=srfgrid, UCount=number_slider_15, VCount=number_slider_15, Overhang=True, Equalize=False)
wblaplace = WeaverbirdsLaplacianSmoothing(MeshCurves=mesh_uv_2, Level=number_slider_13, SmoothNakedEdges=1, Thin=1)
contour = Contour(Shape=wblaplace, Point=Point(0, 0, 0), Direction=Vector(0, 0, 1), Distance=number_slider_14)
eval = EvaluateCurve(Curve=contour, Parameter=0)  # -> Point, Tangent, Angle
pdecon = Deconstruct(Point=eval.Point)  # -> XComponent, YComponent, ZComponent
bnd_5 = Bounds(Numbers=flatten(pdecon.ZComponent))
dedomain_2 = DeconstructDomain(Domain=bnd_5)  # -> Start, End
gradient_2 = Gradient(
    LowerLimit=dedomain_2.Start,
    UpperLimit=dedomain_2.End,
    Parameter=flatten(pdecon.ZComponent),
    stops=[0: RGB(0, 128, 0), 0.398: RGB(255, 255, 0), 1: RGB(255, 0, 0)])
previewlw_4 = CustomPreviewLineweights(Geometry=flatten(contour), Shader=gradient_2, Absolute=False)

sdivide_3 = DivideSurface(Surface=rectangle.Rectangle, UCount=number_slider_7, VCount=number_slider_7)  # -> flatten(Points), Normals, Parameters
dom_4 = ConstructDomain(DomainStart=number_slider_9, DomainEnd=number_slider_10)
lng = ListLength(List=sdivide_3.Points)
Z_5 = UnitZ(Factor=expr("-x", number_slider_11))
random = Random(Range=dom_4, Number=lng, Seed=2)
line = LineSDL(Start=sdivide_3.Points, Direction=expr("-x", Vector(0, 0, 1)), Length=random)
Z_6 = UnitZ(Factor=expr("-x/2", random))
move_7 = Move(Geometry=line, Motion=Z_5)  # -> Geometry, Transform
move_8 = Move(Geometry=move_7.Geometry, Motion=Z_6)  # -> Geometry, Transform
lng_2 = ListLength(List=move_7.Geometry)
range = Range(Domain=Domain(0, 1), Steps=expr("x-1", lng_2))

# ---- group: 显示颜色
# Line in the Middle
gradient_3 = Gradient(
    LowerLimit=0,
    UpperLimit=1,
    Parameter=flatten(range),
    stops=[0.0603: RGBA(17, 24, 69, 177), 0.512: RGBA(16, 54, 16, 180), 0.879: RGBA(69, 69, 69, 139)])

# ----
jitter = Jitter(List=gradient_3, Jitter=1, Seed=2)  # -> Values, Indices
previewlw_5 = CustomPreviewLineweights(Geometry=flatten(move_8.Geometry), Shader=jitter.Values, Absolute=False)
