# Grasshopper definition Skill 1-p5-Sentiment Map of Han Culture-GH.gh (Grasshopper 1.0.7)
# plug-ins: LunchBox, ShapeDiverForGrasshopper, Weaverbird, Human

sddp = ShapeDiverDocumentPayload({AbsoluteTolerance=0, AngleTolerance=0, DistanceDisplayPrecision=0, GltfVersion="Gltf2", InputGroups="{}", OutputGroups="{}", RelativeTolerance=0, UnitSystem=0, VersionCreated="1.13.1.0", VersionSaved="1.13.1.0"})

# ---- group: Select on file
path = FilePath("D:\A\Skills Module 1 — Cartographies of Affect\2.xls")

# ----
excelread = ExcelReader(ReadExcelData=Toggle(True), WorkbookPath=path, WorksheetName="Sheet1")  # -> Exceptions, ExcelData

# ---- group: 显示范围边长
number_slider = Slider(12, range=0..100)

# ----
shift = ShiftList(List=excelread.ExcelData, Shift=1, Wrap=False)

# ---- group: 边框向下距离
number_slider_2 = Slider(0.6, range=0..10)

# ---- group: 网格细分数
number_slider_3 = Slider(100, range=0..100)

# ---- group: 整体高度
number_slider_4 = Slider(10, range=0..10)

# ---- group: 方格数量
# White Grid
number_slider_5 = Slider(8, range=0..100)

# ---- group: 移动距离
number_slider_6 = Slider(5.25, range=0..20)

# ---- group: 十字标记大小
number_slider_7 = Slider(0.12, range=0..1)

# ---- group: 影响范围
number_slider_8 = Slider(0.3, range=0..10)

# ---- group: 显示大小
number_slider_9 = Slider(0.05, range=0..1)

# ---- group: 引线长度
number_slider_10 = Slider(0.12, range=0..1)

number_slider_11 = Slider(0.12, range=0..1)

# ---- group: 显示大小
number_slider_12 = Slider(3.48, range=0..10)

# ---- group: 高度
number_slider_13 = Slider(3, range=0..10)

# ---- group: 网格方向控制点数量
number_slider_14 = Slider(100, range=0..100)

# ---- group: 顺滑迭代次数
number_slider_15 = Slider(2, range=0..100)

# ---- group: 均分线间距
number_slider_16 = Slider(0.028, range=0..1)

# ----
shift_2 = ShiftList(List=shift, Shift=1, Wrap=False)
bnd = Bounds(Numbers=shift_2)
# Top Dividing Line
dom = ConstructDomain(DomainStart=0, DomainEnd=number_slider)
remap = RemapNumbers(Value=shift_2, Source=bnd, Target=dom)  # -> Mapped, Clipped
bang = ExplodeTree(Data=remap.Mapped)  # -> Branch0, Branch1, Branch2
number_slider_17 = Slider(50, range=0..100)
pt = ConstructPoint(XCoordinate=bang.Branch0, YCoordinate=bang.Branch1, ZCoordinate=0)
rectangle = Rectangle(Plane=PlaneXY(0, 0, 0), XSize=number_slider, YSize=number_slider, Radius=0)  # -> Rectangle, Length
sdivide = DivideSurface(Surface=rectangle.Rectangle, UCount=number_slider_17, VCount=number_slider_17)  # -> flatten(Points), Normals, Parameters
cullpt = CullDuplicates(Points=pt, Tolerance=0.1, CullMode=3)  # -> Points, Indices, Valence
pt_2 = Point(sdivide.Points)
dist = Distance(PointA=graft(cullpt.Points), PointB=pt_2)
item = ListItem(List=bang.Branch2, Index=cullpt.Indices, Wrap=True)  # -> graft(Item)
bnd_2 = Bounds(Numbers=dist)
dom_2 = ConstructDomain(DomainStart=0, DomainEnd=item)
remap_2 = RemapNumbers(Value=dist, Source=bnd_2, Target=dom_2)  # -> Mapped, Clipped
flip = FlipMatrix(Data=remap_2.Mapped)
min = Minimum(A=flip, B=number_slider_8)
ma = MassAddition(Input=min)  # -> flatten(Result), PartialResults
bnd_3 = Bounds(Numbers=ma.Result)
remap_3 = RemapNumbers(Value=ma.Result, Source=bnd_3, Target=Domain(0, 1))  # -> Mapped, Clipped
graph = GraphMapper(
    remap_3.Mapped,
    x0=0,
    x1=1,
    y0=0,
    y1=1,
    container_name="Bezier",
    cpx=[0, 0.1683526486, 1, 1],
    cpy=[0, 0.3642604947, 0.4532642961, 1])
bnd_4 = Bounds(Numbers=graph)
dom_3 = ConstructDomain(DomainStart=number_slider_13, DomainEnd=Slider(0, range=0..100))
remap_4 = RemapNumbers(Value=graph, Source=bnd_4, Target=dom_3)  # -> Mapped, Clipped
Z = UnitZ(Factor=remap_4.Mapped)
move = Move(Geometry=pt_2, Motion=Z)  # -> Geometry, Transform
srfgrid = SurfaceFromPoints(Points=move.Geometry, UCount=expr("x+1", number_slider_17), Interpolate=False)
mesh_uv = MeshSurface(Surface=srfgrid, UCount=number_slider_14, VCount=number_slider_14, Overhang=True, Equalize=False)
wblaplace = WeaverbirdsLaplacianSmoothing(MeshCurves=mesh_uv, Level=number_slider_15, SmoothNakedEdges=1, Thin=1)
pt_3 = ConstructPoint(XCoordinate=0, YCoordinate=0, ZCoordinate=Slider(0.01, range=0..0.01))
contour = Contour(Shape=wblaplace, Point=pt_3, Direction=Vector(0, 0, 1), Distance=number_slider_16)
eval = EvaluateCurve(Curve=contour, Parameter=0)  # -> Point, Tangent, Angle
pdecon = Deconstruct(Point=eval.Point)  # -> XComponent, YComponent, ZComponent
bnd_5 = Bounds(Numbers=flatten(pdecon.ZComponent))
dedomain = DeconstructDomain(Domain=bnd_5)  # -> Start, End
gradient = Gradient(
    LowerLimit=dedomain.End,
    UpperLimit=dedomain.Start,
    Parameter=flatten(pdecon.ZComponent),
    stops=[0: RGB(157, 248, 213), 0.0131: RGBA(255, 236, 64, 125), 0.457: RGB(255, 23, 23), 0.674: RGB(145, 201, 250), 0.899: RGBA(0, 33, 150, 169)])
previewlw = CustomPreviewLineweights(Geometry=flatten(contour), Shader=gradient, Absolute=False)

Z_2 = UnitZ(Factor=expr("-x", number_slider_2))
move_2 = Move(Geometry=rectangle.Rectangle, Motion=Z_2)  # -> Geometry, Transform
Z_3 = UnitZ(Factor=expr("-x", number_slider_4))
sdivide_2 = DivideSurface(Surface=move_2.Geometry, UCount=number_slider_5, VCount=number_slider_5)  # -> Points, Normals, Parameters
dom_4 = ConstructDomain(DomainStart=expr("-x", number_slider_7), DomainEnd=number_slider_7)
flip_2 = FlipMatrix(Data=sdivide_2.Points)
rectangle_2 = Rectangle(Plane=sdivide_2.Points, XSize=dom_4, YSize=dom_4, Radius=0)  # -> Rectangle, Length
move_3 = Move(Geometry=move_2.Geometry, Motion=Z_3)  # -> Geometry, Transform
pline = PolyLine(Vertices=sdivide_2.Points, Closed=False)  # -> flatten(Polyline)
pline_2 = PolyLine(Vertices=flip_2, Closed=False)  # -> flatten(Polyline)
explode = Explode(Curve=rectangle_2.Rectangle, Recursive=True)  # -> Segments, Vertices
shift_3 = ShiftList(List=pline_2, Shift=1, Wrap=False)
shift_4 = ShiftList(List=pline, Shift=1, Wrap=False)
disc = Discontinuity(Curve=move_2.Geometry, Level=1)  # -> Points, Parameters
disc_2 = Discontinuity(Curve=move_3.Geometry, Level=1)  # -> Points, Parameters
midpt = CurveMiddle(Curve=explode.Segments)
explode_2 = Explode(Curve=move_2.Geometry, Recursive=True)  # -> Segments, Vertices
explode_3 = Explode(Curve=move_3.Geometry, Recursive=True)  # -> Segments, Vertices
shift_5 = ShiftList(List=shift_3, Shift=-1, Wrap=False)
shift_6 = ShiftList(List=shift_4, Shift=-1, Wrap=False)
item_2 = ListItem(List=midpt, Index=0, Wrap=True)  # -> Item, Item1, Item2, Item3
midpt_2 = CurveMiddle(Curve=explode_2.Segments)
midpt_3 = CurveMiddle(Curve=explode_3.Segments)
ln = Line(StartPoint=disc.Points, EndPoint=disc_2.Points)
ln_2 = Line(StartPoint=midpt_2, EndPoint=midpt_3)
ln_3 = Line(StartPoint=item_2.Item1, EndPoint=item_2.Item3)
ln_4 = Line(StartPoint=item_2.Item, EndPoint=item_2.Item2)
dash = DashPattern(Curve=[shift_6, shift_5], Pattern=number_slider_10)  # -> Dashes, Gaps
move_4 = Move(Geometry=[ln_4, ln_3], Motion=Z_3)  # -> Geometry, Transform
move_5 = Move(Geometry=dash.Dashes, Motion=Z_3)  # -> Geometry, Transform
dash_2 = DashPattern(Curve=[ln, ln_2], Pattern=number_slider_11)  # -> Dashes, Gaps
previewlw_2 = CustomPreviewLineweights(
    Geometry=flatten([move_2.Geometry, move_3.Geometry]),
    Shader=ColourSwatch(SwatchColor=RGB(255, 255, 255)),
    Absolute=False)
previewlw_3 = CustomPreviewLineweights(
    Geometry=flatten(move_4.Geometry),
    Shader=ColourSwatch(SwatchColor=RGB(255, 255, 255)),
    Thickness=number_slider_12,
    Absolute=False)
previewlw_4 = CustomPreviewLineweights(Geometry=flatten(move_5.Geometry), Shader=ColourSwatch(SwatchColor=RGB(176, 176, 176)), Absolute=False)
previewlw_5 = CustomPreviewLineweights(Geometry=flatten(dash_2.Dashes), Shader=ColourSwatch(SwatchColor=RGB(255, 255, 255)), Absolute=False)

boundary = BoundarySurfaces(Edges=move_2.Geometry)
mesh_uv_2 = MeshSurface(Surface=boundary, UCount=number_slider_3, VCount=number_slider_3, Overhang=True, Equalize=False)
demesh = DeconstructMesh(Mesh=mesh_uv_2)  # -> Vertices, Faces, Colours, Normals
# Black and White Ground
pull = PullPoint(Point=demesh.Vertices, Geometry=cullpt.Points, ClosestOnly=True)  # -> ClosestPoint, Distance
bnd_6 = Bounds(Numbers=flatten(pull.Distance))
dedomain_2 = DeconstructDomain(Domain=bnd_6)  # -> Start, End
gradient_2 = Gradient(
    LowerLimit=dedomain_2.Start,
    UpperLimit=dedomain_2.End,
    Parameter=flatten(pull.Distance),
    stops=[0: RGB(255, 255, 255), 0.01: RGB(0, 0, 0)])
conmesh = ConstructMesh(Vertices=demesh.Vertices, Faces=demesh.Faces, Colours=gradient_2)
Z_4 = UnitZ(Factor=expr("-x", number_slider_4))
move_6 = Move(Geometry=conmesh, Motion=Z_4)  # -> Geometry, Transform

bnd_7 = Bounds(Numbers=bang.Branch2)
# the Middle Point
dedomain_3 = DeconstructDomain(Domain=bnd_7)  # -> Start, End
gradient_3 = Gradient(
    LowerLimit=dedomain_3.Start,
    UpperLimit=dedomain_3.End,
    Parameter=flatten(bang.Branch2),
    stops=[0: RGB(74, 80, 135), 0.379: RGB(255, 255, 255), 0.622: RGB(255, 0, 0)])
Z_5 = UnitZ(Factor=expr("-x", number_slider_6))
move_7 = Move(Geometry=pt, Motion=Z_5)  # -> Geometry, Transform
cloud = CloudDisplay(Points=move_7.Geometry, Colours=gradient_3, Size=number_slider_9, SpriteType=0)
