# Grasshopper definition Skill 2-p4-Date and Environment-GH.gh (Grasshopper 1.0.8)
# plug-ins: Human, Heron, eleFront5

number_slider = Slider(200, range=0..1000)

# ---- group: Input
x = Panel("70")
# SPATIAL BINNING IN GRASSHOPPER
geo = Geometry([<point referenced from the Rhino model> x1277])
y = Panel("70")

# ---- group: Inclusion
sqgrid = Square(Plane=PlaneXY(0, 0, 0), Size=Slider(3, range=0..10), ExtentX=x, ExtentY=y)  # -> flatten(Cells), Points
area = Area(Geometry=sqgrid.Cells)  # -> Area, Centroid
merge = Merge(Data1=geo, Data2=area.Centroid)
pt = Point(merge)
incurves = PointInCurves(Point=pt, Curves=sqgrid.Cells)  # -> Relationship, Index, Point

# ---- group: Check all cells
multiplication = Multiplication(A=x, B=y)
series = Series(Start=0, Step=1, Count=multiplication)  # -> simplify(graft(Series))
equals = Equality(FirstNumber=incurves.Index, SecondNumber=series)  # -> Equality, Inequality
cull = CullPattern(List=pt, CullPattern=equals.Equality)
panel = Panel(cull)

# ---- group: Check one cell
equals_2 = Equality(FirstNumber=incurves.Index, SecondNumber="12")  # -> Equality, Inequality
cull_2 = CullPattern(List=pt, CullPattern=equals_2.Equality)
panel_2 = Panel(cull_2)

# ----
# How do you read the result?
# 
# The first line isn0 | 21
# and that means that Point 0 is in
# curve 21
# 
# Same is true for
# 1 | 21
# 
# And the third line is 2 | 12
# and that means that point 2
# is in curve 12.
panel_3 = Panel(incurves.Index)
tstat = TreeStatistics(Tree=cull)  # -> Paths, Length, Count

# ---- group: Surface Grid
# Add contrast by "streching" the numbers
bnd = Bounds(Numbers=flatten(tstat.Length))
dom = ConstructDomain(DomainStart="0", DomainEnd="15")
remap = RemapNumbers(Value=tstat.Length, Source=bnd, Target=dom)  # -> Mapped, Clipped
Z = UnitZ(Factor=remap.Mapped)
move = Move(Geometry=area.Centroid, Motion=Z)  # -> Geometry, Transform
srfgrid = SurfaceFromPoints(Points=move.Geometry, UCount=x, Interpolate=False)

# ----
number_slider_2 = Slider(100, range=0..100)

# ---- group: Graphics & Baking
contour = Contour(Shape=srfgrid, Point=Point(0, 0, 0), Direction=Vector(0, 0, 1), Distance=Slider(0.2, range=0..1))
eval = EvaluateCurve(Curve=contour, Parameter=0)  # -> Point, Tangent, Angle
pdecon = Deconstruct(Point=eval.Point)  # -> XComponent, YComponent, ZComponent
bnd_2 = Bounds(Numbers=flatten(pdecon.ZComponent))
dedomain = DeconstructDomain(Domain=bnd_2)  # -> Start, End
gradient = Gradient(
    LowerLimit=dedomain.Start,
    UpperLimit=dedomain.End,
    Parameter=flatten(pdecon.ZComponent),
    stops=[0: RGB(234, 38, 0), 0.177: RGB(234, 126, 0), 0.332: RGB(254, 244, 84), 0.871: RGB(173, 203, 249), 1: RGB(75, 107, 169)])
preview = CustomPreview(Geometry=flatten(contour), Material=gradient)
createatts = CreateAttributes(LayerName="Contours", Color=gradient, enableFullPath=False)
bake = BakeGeometry(Bake=Button(), Geometry=flatten(contour), Attributes=createatts, DeleteOldBakes=False, PreserveTrees=False)

# ----
# The earth anchor point has to be set in any case.
# The 0,0,0 point of Rhino has to be set to a real world coordinate.
# You can get the point by searching for it. Or you simply look up a place in google maps, copy/paste the cooridantes and plug them into the "SetEAP" component.
panel_4 = Panel("Venice，Italy,castello")
restgeocode = ESRIRESTServiceGeocode(Addresses=panel_4)  # -> Candidates, Latitude, Longitude
lat = Panel("45.43577466")
long = Panel("12.34439242")
branch = TreeBranch(Tree=restgeocode.Candidates, Path="0;0", MaintainPaths=True)
branch_2 = TreeBranch(Tree=restgeocode.Latitude, Path="0;0", MaintainPaths=True)
branch_3 = TreeBranch(Tree=restgeocode.Longitude, Path="0;0", MaintainPaths=True)
panel_5 = Panel(restgeocode.Candidates)
seteap = SetEarthAnchorPoint(SetEAP=Toggle(False), Latitude=branch_2, Longitude=branch_3)
panel_6 = Panel(branch)

panel_7 = Panel(branch_3)
panel_9 = Panel(branch_2)
seteap_2 = SetEarthAnchorPoint(SetEAP=Button(), Latitude=lat, Longitude=long)

# ----
# Field values of OSM are here:
# https://wiki.openstreetmap.org/wiki/Map_features
# you can test example values here:
# https://www.openstreetmap.org/node/6429327326
# 
# The format is
# [Key],[Value]
filterfiields = Panel("natural")
path = FilePath("D:\1group D\tearm2\field.trip\data\GH\map (2).osm")
# IMPORT AND FILTER OSM
geo_2 = Geometry(<curve referenced from the Rhino model>)
panel_10 = Panel("addr:postcode,SE1 7ND")
panel_11 = Panel("amenity,cafe")
filterfieldvalue = Panel("natural,tree")
importosm = ImportOSM(Boundary=geo_2, OSMDataLocation=path, Clipped=True)  # -> Extents, Fields, Values, FeatureGeometry, Buildings

filterfieldvalue_2 = Panel("[Key],[Value]")

path_2 = FilePath("D:\1group D\tearm2\2.19\路线3_同一地点取平均_按时间排序.csv")
file = ReadFile(File=path_2, PerLineParse=True)
panel_12 = Panel(file)
tab = Panel(",")
cull_i = CullIndex(List=file, Indices="0", Wrap=True)
split = TextSplit(Text=cull_i, Separators=tab)
item = ListItem(List=split, Index="0", Wrap=True)  # -> Item, Item1, flatten(Item2), flatten(Item3), flatten(Item4), Item5, Item6, flatten(Item7)

panel_13 = Panel(item.Item7)

item_2 = ListItem(List=split, Index="5", Wrap=True)
tstat_2 = TreeStatistics(Tree=item_2)  # -> Paths, Length, Count
dup = DuplicateData(Data="GSR", Number=tstat_2.Length, Order=True)  # -> simplify(Data)
ef_att = EleFrontAttributes(Keys=dup, Values=item_2, Layer="Points", maintainBakeName=False)  # -> flatten(Attributes), Keys, Values, Name, Layer, ColourSource, DisplayColour, MaterialSource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

flatten = FlattenTree(Tree=item.Item1, Path="{0}")
flatten_2 = FlattenTree(Tree=item.Item, Path="{0}")

# ----
# Reading textfiles (with Grasshopper)
# SET ANCHOR POINT
# CONVERT COORDINATES TO XY VALUES
# Bake with attributes (optional)
panel_14 = Panel(item_2)
panel_15 = Panel(cull_i)
panel_16 = Panel(dup)
flatten_tree = FlattenTree(Tree=item.Item1, Path="{0}")
flatten_tree_2 = FlattenTree(Tree=item.Item, Path="{0}")
panel_17 = Panel(item.Item)
number_slider_3 = Slider(435, range=0..1000)
panel_18 = Panel(item.Item2)
decimal_degrees_to_xy = DecimalDegreesToXY(Latitude=flatten_tree_2, Longitude=flatten_tree)  # -> XyPoint, Transform
pt_2 = ConstructPoint(XCoordinate=item.Item1, YCoordinate=item.Item, ZCoordinate=0)
multiplication_2 = Multiplication(A=item.Item3, B=Slider(200, range=0..1000))
multiplication_3 = Multiplication(A=item.Item4, B=Slider(2270, range=0..10000))
panel_20 = Panel(multiplication_2)
deconstruct = Deconstruct(Point=decimal_degrees_to_xy.XyPoint)  # -> XComponent, YComponent, ZComponent
addition = Addition(A=multiplication_2, B=Slider(150000, range=0..1000000))
multiplication_4 = Multiplication(A=item.Item2, B=Slider(1220, range=0..10000))
addition_2 = Addition(A=multiplication_3, B=Slider(300000, range=0..1000000))
multiplication_5 = Multiplication(A=item.Item7, B=Slider(10, range=0..100000))
panel_21 = Panel(multiplication_4)
panel_22 = Panel(pt_2)
panel_23 = Panel(decimal_degrees_to_xy.XyPoint)
panel_24 = Panel(item.Item1)
panel_25 = Panel(multiplication_5)
pt_3 = ConstructPoint(XCoordinate=deconstruct.XComponent, YCoordinate=deconstruct.YComponent, ZCoordinate=multiplication_4)
pt_4 = ConstructPoint(XCoordinate=deconstruct.XComponent, YCoordinate=deconstruct.YComponent, ZCoordinate=addition_2)
pt_5 = ConstructPoint(XCoordinate=deconstruct.XComponent, YCoordinate=deconstruct.YComponent, ZCoordinate=addition)
polyline = PolyLine(Vertices=pt_4, Closed=False)
ln = Line(StartPoint=decimal_degrees_to_xy.XyPoint, EndPoint=pt_4)
ln_2 = Line(StartPoint=decimal_degrees_to_xy.XyPoint, EndPoint=pt_3)
ln_3 = Line(StartPoint=decimal_degrees_to_xy.XyPoint, EndPoint=pt_5)
panel_26 = Panel(pt_5)
polyline_2 = PolyLine(Vertices=pt_3, Closed=False)
polyline_3 = PolyLine(Vertices=pt_5, Closed=False)
panel_28 = Panel(pt_3)

geo_3 = Geometry(decimal_degrees_to_xy.XyPoint)

bake_2 = BakeObjects(Geometry=geo_3, Attributes=ef_att.Attributes, Bake=False, createGroups=False)  # -> Message, Ghosts

addition_3 = Addition(A=multiplication_5, B=Slider(450000, range=0..1000000))

pt_6 = ConstructPoint(XCoordinate=deconstruct.XComponent, YCoordinate=deconstruct.YComponent, ZCoordinate=addition_3)
ln_4 = Line(StartPoint=decimal_degrees_to_xy.XyPoint, EndPoint=pt_6)
